# Dynamo graph BlockExtensions_Overkill.dyn (Dynamo 2.4.1.6394)
# packages: Civil3DToolkit 1.1.13

current = Autodesk.AutoCAD.DynamoNodes.Document.Current()
getXRefs = Autodesk.AutoCAD.DynamoNodes.DocumentExtensions.GetXRefs(document=current)
block = Autodesk.AutoCAD.DynamoNodes.BlockReference.Block(blockReference=getXRefs)
overkill = Autodesk.AutoCAD.DynamoNodes.BlockExtensions.Overkill(block=block)
