# Dynamo graph BlockReferenceByGeometry.dyn (Dynamo 2.4.1.6394)
# packages: Civil3DToolkit 1.1.7

code_block = CodeBlock { 2; }
byWidthLength = Rectangle.ByWidthLength(length=code_block)
byWidthLength_2 = Rectangle.ByWidthLength(width=code_block)
list_create = List.Create(item0=byWidthLength, item1=byWidthLength_2)
byOrigin = CoordinateSystem.ByOrigin()
code_block_2 = CodeBlock { "Consulting"; null; }
byGeometry = Autodesk.AutoCAD.DynamoNodes.BlockReferenceExtensions.ByGeometry(geometry=list_create, location=byOrigin, name=code_block_2.out0, block=code_block_2.out1)
