# Dynamo graph CogoPoints_UserDefinedProperties.dyn (Dynamo 2.4.1.6394)
# packages: Civil3DToolkit 1.1.9, Civil3DToolkit 1.1.14

code_block = CodeBlock { 0..10; }
byCoordinates = Point.ByCoordinates(x=code_block)
code_block_2 = CodeBlock { "_CP"; }
current = Autodesk.AutoCAD.DynamoNodes.Document.Current()
byGeometry = Autodesk.Civil.DynamoNodes.CogoPoint.ByGeometry(geometry=byCoordinates, layer=code_block_2, document=current)
select_objects = ObjectsSelection()  # 14 picked in the model
code_block_3 = CodeBlock()
# ---------- code_block_3.designscript (22 lines) ----------
"ADSK";
"Angle";
"Area";
"Azimuth";
"Boolean";
"Coordinate";
"Dimension";
"Direction";
"Distance";
"Double";
"Elevation";
"Enumeration";
"Grade";
"Integer";
"Latitude";
"Longitude";
"Percent";
"Rotation";
"Station";
"String";
"Volume";
"Wrong";
# ----------------------------------------
code_block_4 = CodeBlock { "Consulting"; }
setUserDefinedPropertyValueByName = Autodesk.Civil.DynamoNodes.LandDevelopment.CogoPointExtensions.SetUserDefinedPropertyValueByName(point=select_objects, classification=code_block_3.out0, property=code_block_3.out20, value=code_block_4)
getUserDefinedPropertyValueByName = Autodesk.Civil.DynamoNodes.LandDevelopment.CogoPointExtensions.GetUserDefinedPropertyValueByName(point=setUserDefinedPropertyValueByName, classification=code_block_3.out0, property=code_block_3.out20)
code_block_5 = CodeBlock { 20; }
code_block_6 = CodeBlock { false; }
code_block_7 = CodeBlock { "C"; }
