# Dynamo graph CogoPoints_UserDefinedPropertiesClassifications.dyn (Dynamo 2.4.1.6394)
# packages: Civil3DToolkit 1.1.15

code_block = CodeBlock { "ADSK"; "Name"; 3; }
createUDPClassification = Autodesk.Civil.DynamoNodes.LandDevelopment.CogoPointExtensions.CreateUDPClassification(classification=code_block.out0)
createUDP = Autodesk.Civil.DynamoNodes.LandDevelopment.CogoPointExtensions.CreateUDP(classification=createUDPClassification, property=code_block.out1, attributeType=code_block.out2)
removeUDP = Autodesk.Civil.DynamoNodes.LandDevelopment.CogoPointExtensions.RemoveUDP(classification=createUDPClassification, property=code_block.out1)  # frozen
code_block_2 = CodeBlock { "Menù"; }
code_block_3 = CodeBlock { ["Pasta", "Pizza", "Tiramisù"]; }
code_block_4 = CodeBlock { "Pizza"; }
setUDPEnum = Autodesk.Civil.DynamoNodes.LandDevelopment.CogoPointExtensions.SetUDPEnum(classification=code_block.out0, property=code_block_2, values=code_block_3, defaultValue=code_block_4)
code_block_5 = CodeBlock { 3; }
randomList = Math.RandomList(amount=code_block_5)
randomList_2 = Math.RandomList(amount=code_block_5)
randomList_3 = Math.RandomList(amount=code_block_5)
byCoordinates = Point.ByCoordinates(x=randomList, y=randomList_2, z=randomList_3)
code_block_6 = CodeBlock { "_ADSK"; }
current = Autodesk.AutoCAD.DynamoNodes.Document.Current()
byGeometry = Autodesk.Civil.DynamoNodes.CogoPoint.ByGeometry(geometry=byCoordinates, layer=code_block_6, document=current)
