# Dynamo graph Import LandXML.dyn (Dynamo 2.4.1.6394)
# packages: Civil3DToolkit 1.1.14

current = Autodesk.AutoCAD.DynamoNodes.Document.Current()
file_path = Filename("..\..\..\..\_Download\TAE-AVP2-M3NO-MAQDIS-TRANSASS-TRANSNO-TRAC.xml")
getLandXMLCrossSectData = Autodesk.AutoCAD.DynamoNodes.DocumentExtensions.GetLandXMLCrossSectData(document=current, path=file_path)
keys = DesignScript.Builtin.Dictionary.Keys(dictionary=getLandXMLCrossSectData)
alignmentByName = Autodesk.Civil.DynamoNodes.Selection.AlignmentByName(name=keys, document=current)
code_block = CodeBlock(a=alignmentByName) { a[1]; }
valueAtKey = DesignScript.Builtin.Dictionary.ValueAtKey(dictionary=getLandXMLCrossSectData, key=keys)
keys_2 = DesignScript.Builtin.Dictionary.Keys(dictionary=valueAtKey)
valueAtKey_2 = DesignScript.Builtin.Dictionary.ValueAtKey(dictionary=valueAtKey, key=keys_2)
keys_3 = DesignScript.Builtin.Dictionary.Keys(dictionary=valueAtKey_2)
valueAtKey_3 = DesignScript.Builtin.Dictionary.ValueAtKey(dictionary=valueAtKey_2, key=keys_3)
code_block_2 = CodeBlock { 0; 1; 2; }
getItemAtIndex = List.GetItemAtIndex(list=valueAtKey_3@@L3, index=code_block_2.out0)
code_block_3 = CodeBlock { -1; }
dropItems = List.DropItems(list=getItemAtIndex@@L2, amount=code_block_3)
code_block_4 = CodeBlock(a=dropItems) { a[1][0][0]; }
getItemAtIndex_2 = List.GetItemAtIndex(list=valueAtKey_3@@L3, index=code_block_2.out1)
dropItems_2 = List.DropItems(list=getItemAtIndex_2@@L3, amount=code_block_3)
code_block_5 = CodeBlock(a=dropItems_2) { a[1][0][0]; }
coordinateSystemByStationOffset = Autodesk.Civil.DynamoNodes.Alignment.CoordinateSystemByStationOffset(alignment=code_block, station=code_block_4@L1, offset=code_block_5@L2)
origin = CoordinateSystem.Origin(coordinateSystem=coordinateSystemByStationOffset)
getItemAtIndex_3 = List.GetItemAtIndex(list=valueAtKey_3@@L3, index=code_block_2.out2)
dropItems_3 = List.DropItems(list=getItemAtIndex_3@@L3, amount=code_block_3)
code_block_6 = CodeBlock(a=dropItems_3) { a[1][0][0]; }
translate = Geometry.Translate(geometry=origin, zTranslation=code_block_6)
code_block_7 = CodeBlock { "_cogo"; }
byGeometry = Autodesk.Civil.DynamoNodes.CogoPoint.ByGeometry(geometry=translate, layer=code_block_7, document=current)
flatten = List.Flatten(list=byGeometry)
code_block_8 = CodeBlock(a=keys_2) { a[1][0][0]; }
byCogoPoints = Autodesk.Civil.DynamoNodes.CogoPointGroup.ByCogoPoints(cogoPoints=flatten, cogoPointGroupName=code_block_8, document=current)
name = Autodesk.Civil.DynamoNodes.CogoPointGroup.Name(cogoPointGroup=byCogoPoints)
code_block_9 = CodeBlock { "_tin"; }
byCogoPointGroup = Autodesk.Civil.DynamoNodes.TinSurface.ByCogoPointGroup(cogoPointGroupName=name, surfaceName=name, layer=code_block_9, document=current)
