# Dynamo graph GIS_Spatial Filter.dyn (Dynamo 2.4.1.6394)
# packages: Civil3DToolkit 1.1.4

contains = Autodesk.Civil.DynamoNodes.GIS.MapLayer_SpatialOperations.Contains()
crosses = Autodesk.Civil.DynamoNodes.GIS.MapLayer_SpatialOperations.Crosses()
disjoint = Autodesk.Civil.DynamoNodes.GIS.MapLayer_SpatialOperations.Disjoint()
envelopeIntersects = Autodesk.Civil.DynamoNodes.GIS.MapLayer_SpatialOperations.EnvelopeIntersects()
current = Autodesk.Civil.DynamoNodes.GIS.Map.Current()
code_block = CodeBlock { "Structures"; "Pipes"; "Houses"; }
getLayerByName = Autodesk.Civil.DynamoNodes.GIS.Map.GetLayerByName(map=current, name=code_block.out2)
select_object = ObjectSelection()  # 1 picked in the model
geometry = Autodesk.AutoCAD.DynamoNodes.Object.Geometry(object=select_object)
spatial_operations = SpatialOperationsDropDown("Inside")
getFeaturesBySpatialFilter = Autodesk.Civil.DynamoNodes.GIS.MapLayer.GetFeaturesBySpatialFilter(mapLayer=getLayerByName, boundary=geometry, operation=spatial_operations)
geometry_2 = Autodesk.Civil.DynamoNodes.GIS.MapFeature.Geometry(mapFeature=getFeaturesBySpatialFilter)
equals = Autodesk.Civil.DynamoNodes.GIS.MapLayer_SpatialOperations.Equals()
inside = Autodesk.Civil.DynamoNodes.GIS.MapLayer_SpatialOperations.Inside()
intersects = Autodesk.Civil.DynamoNodes.GIS.MapLayer_SpatialOperations.Intersects()
overlaps = Autodesk.Civil.DynamoNodes.GIS.MapLayer_SpatialOperations.Overlaps()
touches = Autodesk.Civil.DynamoNodes.GIS.MapLayer_SpatialOperations.Touches()
within = Autodesk.Civil.DynamoNodes.GIS.MapLayer_SpatialOperations.Within()
properties = Autodesk.Civil.DynamoNodes.GIS.MapFeature.Properties(mapFeature=getFeaturesBySpatialFilter)
layers = Autodesk.Civil.DynamoNodes.GIS.Map.Layers(map=current)  # frozen
getFeaturesByTextFilter = Autodesk.Civil.DynamoNodes.GIS.MapLayer.GetFeaturesByTextFilter(mapLayer=layers)
geometry_3 = Autodesk.Civil.DynamoNodes.GIS.MapFeature.Geometry(mapFeature=getFeaturesByTextFilter)
id = Autodesk.Civil.DynamoNodes.GIS.MapFeature.Id(mapFeature=getFeaturesBySpatialFilter)
