# Dynamo graph GIs.dyn (Dynamo 2.1.1.7865)

current = Autodesk.Civil.DynamoNodes.GIS.Map.Current()
layers = Autodesk.Civil.DynamoNodes.GIS.Map.Layers(map=current)
code_block = CodeBlock(a=layers) { a[5]; }
features = Autodesk.Civil.DynamoNodes.GIS.MapLayer.Features(mapLayer=code_block)
code_block_2 = CodeBlock(a=features) { a[0..10]; }
geometry = Autodesk.Civil.DynamoNodes.GIS.MapFeature.Geometry(mapFeature=code_block_2)
properties = Autodesk.Civil.DynamoNodes.GIS.MapFeature.Properties(mapFeature=code_block_2)
