# Dynamo graph Parcels.dyn (Dynamo 2.4.1.6326)
# packages: Civil3DToolkit 1.0.0

code_block = CodeBlock()
# ---------- code_block.designscript (3 lines) ----------
["C-PROP",
"0",
"C-PROP-LINE"];
# ----------------------------------------
current = Autodesk.AutoCAD.DynamoNodes.Document.Current()
modelSpace = Autodesk.AutoCAD.DynamoNodes.Document.ModelSpace(document=current)
all_objects_on_layer = AcObjectsOnLayer(layer=code_block, block=modelSpace)
flatten = List.Flatten(list=all_objects_on_layer)
byObject = Autodesk.Civil.DynamoNodes.LandDevelopment.Parcel.ByObject(obj=flatten)
code_block_2 = CodeBlock { false; }
clean = List.Clean(list=byObject, preserveIndices=code_block_2)
centroid = Autodesk.Civil.DynamoNodes.LandDevelopment.Parcel.Centroid(parcel=clean)
area = Autodesk.Civil.DynamoNodes.LandDevelopment.Parcel.Area(parcel=clean)
number = Autodesk.Civil.DynamoNodes.LandDevelopment.Parcel.Number(parcel=clean)
areaSelectionLabelLocation = Autodesk.Civil.DynamoNodes.LandDevelopment.Parcel.AreaSelectionLabelLocation(parcel=clean)
python_script = Python()  # unwired: IN[0]
# ---------- python_script.python (88 lines) ----------
"""
Copyright 2019 Autodesk, Inc. All rights reserved.

This file is part of the Civil 3D Python Module.

"""
__author__ = 'Paolo Emilio Serra - paolo.serra@autodesk.com'
__copyright__ = '2019'
__version__ = '1.0.0'

import clr

# Add Assemblies for AutoCAD and Civil 3D APIs
clr.AddReference('acmgd')
clr.AddReference('acdbmgd')
clr.AddReference('accoremgd')
clr.AddReference('AecBaseMgd')
clr.AddReference('AecPropDataMgd')
clr.AddReference('AeccDbMgd')
clr.AddReference('AeccPressurePipesMgd')
clr.AddReference('acdbmgdbrep')
clr.AddReference('System.Windows.Forms')
clr.AddReference('AutoCADNodes')

# Add standard Python references
import sys
sys.path.append('C:\Program Files (x86)\IronPython 2.7\Lib')
import os
import math

# Add references to manage arrays, collections and interact with the user
from System import *
from System.IO import *
from System.Collections.Specialized import *
from System.Windows.Forms import MessageBox

# Create an alias to the Autodesk.AutoCAD.ApplicationServices.Application class
import Autodesk.AutoCAD.ApplicationServices.Application as acapp

# Import references from AutoCAD
from Autodesk.AutoCAD.Runtime import *
from Autodesk.AutoCAD.ApplicationServices import *
from Autodesk.AutoCAD.EditorInput import *
from Autodesk.AutoCAD.DatabaseServices import *
from Autodesk.AutoCAD.Geometry import *

# Import references for PropertySets
from Autodesk.Aec.PropertyData import *
from Autodesk.Aec.PropertyData.DatabaseServices import *

# Import references for Civil 3D
from Autodesk.Civil.ApplicationServices import *
from Autodesk.Civil.DatabaseServices import *

from Autodesk.AutoCAD.DynamoNodes import *

adoc = acapp.DocumentManager.MdiActiveDocument
ed = adoc.Editor

# Example function
def my_function():
	"""
	Description....
	:param first_param: ....
	:returns: ....
	"""
		
	global adoc
	
	output = []

	with adoc.LockDocument():
		with adoc.Database as db:
			with db.TransactionManager.StartTransaction() as t:
				bt = t.GetObject(db.BlockTableId, OpenMode.ForWrite)
				btr = t.GetObject(bt[BlockTableRecord.ModelSpace], OpenMode.ForWrite)
				
				for oid in btr:
					obj = t.GetObject(oid, OpenMode.ForRead)
					if isinstance(obj, Parcel):
						if obj.Number == 116:
							output.append(Object.InternalMakeObject(obj.BaseCurve, False))

				t.Commit()
	return output
	
	
OUT = my_function()
# ----------------------------------------
geometry = Autodesk.Civil.DynamoNodes.LandDevelopment.Parcel.Geometry(parcel=clean)
styleName = Autodesk.Civil.DynamoNodes.LandDevelopment.Parcel.StyleName(parcel=clean)
groupByKey = List.GroupByKey(list=geometry, keys=styleName)
code_block_3 = CodeBlock(a=groupByKey.groups) { a[0..1]; }
byPatch = Surface.ByPatch(closedCurve=code_block_3)
color_palette = ColorPalette({R: 95, G: 158, B: 160, A: 255})
color_palette_2 = ColorPalette({R: 135, G: 206, B: 250, A: 255})
list_create = List.Create(item0=color_palette, item1=color_palette_2)
byGeometryColor = Modifiers.GeometryColor.ByGeometryColor(geometry=byPatch, color=list_create)
