# Dynamo graph ObjectData in Block.dyn (Dynamo 2.4.1.6394)
# packages: Civil3DToolkit 1.1.11

code_block = CodeBlock { "Name"; "Table"; "MyTable"; false; }
odfield_data_types = OdDataTypeDropDown("Character")
create = Autodesk.Civil.DynamoNodes.GIS.ObjectData.OdField.Create(name=code_block.out0, dataType=odfield_data_types)
addTable = Autodesk.Civil.DynamoNodes.GIS.ObjectData.OdTable.AddTable(name=code_block.out1, fields=create, description=code_block.out2, isXDataRecords=code_block.out3)
select_object = ObjectSelection()  # 1 picked in the model
create_2 = Autodesk.Civil.DynamoNodes.GIS.ObjectData.OdRecord.Create(table=addTable, obj=select_object)
code_block_2 = CodeBlock { "ADSK Consulting"; }
setValueByName = Autodesk.Civil.DynamoNodes.GIS.ObjectData.OdRecord.SetValueByName(odRecord=create_2, name=code_block.out0, value=code_block_2)
