# Dynamo graph ObjectExtensions_ReadProperties.dyn (Dynamo 2.4.1.6394)
# packages: Civil3DToolkit 1.1.11

select_objects = ObjectsSelection()  # 5 picked in the model
code_block = CodeBlock { "Position"; }
getParameterByName = Autodesk.AutoCAD.DynamoNodes.ObjectExtensions.GetParameterByName(obj=select_objects, name=code_block)
python_script = Python(IN[0]=getParameterByName)
# ---------- python_script.python (4 lines) ----------
import clr
clr.AddReference('ProtoGeometry')
from Autodesk.DesignScript.Geometry import Point
OUT = [Point.ByCoordinates(p.X, p.Y, p.Z) for p in IN[0]]
# ----------------------------------------
