# Dynamo graph UDP Get and Set.dyn (Dynamo 2.4.1.6394)
# packages: Civil3DToolkit 1.0.18

current = Autodesk.AutoCAD.DynamoNodes.Document.Current()
getSites = Autodesk.Civil.DynamoNodes.LandDevelopment.Site.GetSites(document=current)
getParcels = Autodesk.Civil.DynamoNodes.LandDevelopment.Site.GetParcels(site=getSites)
getUserDefinedProperties = Autodesk.Civil.DynamoNodes.LandDevelopment.Parcel.GetUserDefinedProperties(parcel=getParcels)
geometry = Autodesk.Civil.DynamoNodes.LandDevelopment.Parcel.Geometry(parcel=getParcels)
code_block = CodeBlock { "ADSK"; "Comment"; }
code_block_2 = CodeBlock { "NewValue"; }
setUserDefinedPropertyValueByName = Autodesk.Civil.DynamoNodes.LandDevelopment.Parcel.SetUserDefinedPropertyValueByName(parcel=getParcels, classification=code_block.out0, property=code_block.out1, value=code_block_2)
getUserDefinedPropertyValueByName = Autodesk.Civil.DynamoNodes.LandDevelopment.Parcel.GetUserDefinedPropertyValueByName(parcel=setUserDefinedPropertyValueByName, classification=code_block.out0, property=code_block.out1)
