# Dynamo graph Photos.dyn (Dynamo 2.4.1.6394)
# packages: Civil3DToolkit 1.1.11

direction = Collaboration.Photo.Photo.Direction()  # unwired: photo
current = Autodesk.AutoCAD.DynamoNodes.Document.Current()
blockByName = Autodesk.AutoCAD.DynamoNodes.Document.BlockByName(document=current)  # unwired: name
code_block = CodeBlock { "Photo"; }
modelSpace = Autodesk.AutoCAD.DynamoNodes.Document.ModelSpace(document=current)
byCoordinateSystem = Autodesk.AutoCAD.DynamoNodes.BlockReference.ByCoordinateSystem(sourceBlock=blockByName, layer=code_block, block=modelSpace)  # unwired: coordinateSystem
fileHasExtension = FileSystem.FileHasExtension()  # unwired: path
angle = Collaboration.Photo.Photo.Angle()  # unwired: photo
code_block_2 = CodeBlock(a=angle) { -a; }
rotate = CoordinateSystem.Rotate(degrees=code_block_2)  # unwired: coordinateSystem, plane
directory_path = Directory("No file selected.")
code_block_3 = CodeBlock { "*.jpg"; }
boolean = BoolSelector(true)
getDirectoryContents = FileSystem.GetDirectoryContents(directory=directory_path, searchString=code_block_3, includeSubdirectories=boolean)
byFilePath = Collaboration.Photo.Photo.ByFilePath(path=getDirectoryContents.files)
getCoordinateSystemCode = Autodesk.AutoCAD.DynamoNodes.DocumentExtensions.GetCoordinateSystemCode(document=current)
location = Collaboration.Photo.Photo.Location(photo=byFilePath, CurrentSytemCode=getCoordinateSystemCode)
byOrigin = CoordinateSystem.ByOrigin(origin=location)
