# Dynamo graph PolylineExtensions_GetGeometry.dyn (Dynamo 2.4.1.6394)
# packages: Civil3DToolkit 1.1.11

objects_types = AcObjectTypes("Polyline3D")
current = Autodesk.AutoCAD.DynamoNodes.Document.Current()
modelSpace = Autodesk.AutoCAD.DynamoNodes.Document.ModelSpace(document=current)
all_objects_of_type = AcObjectsOfType(type=objects_types, block=modelSpace)
getGeometry = Autodesk.AutoCAD.DynamoNodes.PolylineExtensions.GetGeometry(polyline=all_objects_of_type)
