# Dynamo graph PolylineExtensions_Offset.dyn (Dynamo 2.4.1.6394)
# packages: Civil3DToolkit 1.1.15

objects_types = AcObjectTypes("Polyline")
current = Autodesk.AutoCAD.DynamoNodes.Document.Current()
modelSpace = Autodesk.AutoCAD.DynamoNodes.Document.ModelSpace(document=current)
all_objects_of_type = AcObjectsOfType(type=objects_types, block=modelSpace)
code_block = CodeBlock { [2, -2]; }
offset = Autodesk.AutoCAD.DynamoNodes.PolylineExtensions.Offset(polyline=all_objects_of_type, offset=code_block@L1)
geometry = Autodesk.AutoCAD.DynamoNodes.Object.Geometry(object=offset)
firstItem = List.FirstItem(list=geometry)
reverse = Curve.Reverse(curve=firstItem)
startPoint = Curve.StartPoint(curve=reverse)
lastItem = List.LastItem(list=geometry)
endPoint = Curve.EndPoint(curve=lastItem)
byStartPointEndPoint = Line.ByStartPointEndPoint(startPoint=startPoint, endPoint=endPoint)
startPoint_2 = Curve.StartPoint(curve=lastItem)
endPoint_2 = Curve.EndPoint(curve=reverse)
byStartPointEndPoint_2 = Line.ByStartPointEndPoint(startPoint=startPoint_2, endPoint=endPoint_2)
list_create = List.Create(item0=firstItem, item1=byStartPointEndPoint, item2=lastItem, item3=byStartPointEndPoint_2)
transpose = List.Transpose(lists=list_create@L4)
flatten = List.Flatten(list=transpose@L3)
byJoinedCurves = PolyCurve.ByJoinedCurves(curves=flatten)
code_block_2 = CodeBlock { "OFFSET"; }
objectByGeometry = Autodesk.AutoCAD.DynamoNodes.PolylineExtensions.ObjectByGeometry(curve=byJoinedCurves, layer=code_block_2)
