# Dynamo graph Profile Min Max Points.dyn (Dynamo 2.4.1.6394)
# packages: Civil3DToolkit 1.1.7

current = Autodesk.AutoCAD.DynamoNodes.Document.Current()
alignments = Alignments(document=current)
profiles = Autodesk.Civil.DynamoNodes.Alignment.Profiles(alignment=alignments)
minElevation = Autodesk.Civil.DynamoNodes.ProfileExtensions.MinElevation(profile=profiles)
maxElevation = Autodesk.Civil.DynamoNodes.ProfileExtensions.MaxElevation(profile=profiles)
code_block = CodeBlock { 0.000001; }
code_block_2 = CodeBlock { 0.0001; }
getLayouts = Autodesk.AutoCAD.DynamoNodes.DocumentExtensions.GetLayouts(document=current)
block = Autodesk.AutoCAD.DynamoNodes.Layout.Block(layout=getLayouts)
startStation = Autodesk.Civil.DynamoNodes.Profile.StartStation(profile=profiles)
endStation = Autodesk.Civil.DynamoNodes.Profile.EndStation(profile=profiles)
code_block_3 = CodeBlock(s=startStation, e=endStation) { s..e..0.1; }
elevationByStation = Autodesk.Civil.DynamoNodes.Profile.ElevationByStation(profile=profiles, station=code_block_3)
code_block_4 = CodeBlock(y=elevationByStation) { y * 10; }
byCoordinates = Point.ByCoordinates(x=code_block_3, y=code_block_4)
byPoints = PolyCurve.ByPoints(points=byCoordinates)
highLowPoints = Autodesk.Civil.DynamoNodes.ProfileExtensions.HighLowPoints(profile=profiles)
code_block_5 = CodeBlock(y=highLowPoints.Elevations) { y * 10; }
byCoordinates_2 = Point.ByCoordinates(x=highLowPoints.Stations, y=code_block_5)
code_block_6 = CodeBlock { 10; }
byCenterPointRadius = Circle.ByCenterPointRadius(centerPoint=byCoordinates_2, radius=code_block_6)
