# Dynamo graph TKCorridorFeatureLines_Export as Polyline.dyn (Dynamo 2.4.1.6394)
# packages: Civil3DToolkit 1.1.9

current = Autodesk.AutoCAD.DynamoNodes.Document.Current()
corridors = Corridors(document=current)
baselines = Autodesk.Civil.DynamoNodes.Corridor.Baselines(corridor=corridors)
getTkFeatureLines = Autodesk.Civil.DynamoNodes.CorridorExtensions.CorridorExtensions.GetTkFeatureLines(baseline=baselines)
keys = DesignScript.Builtin.Dictionary.Keys(dictionary=getTkFeatureLines)
valueAtKey = DesignScript.Builtin.Dictionary.ValueAtKey(dictionary=getTkFeatureLines, key=keys)
flatten = List.Flatten(list=valueAtKey)
code_block = CodeBlock(a=flatten) { a[1]; }
code_block_2 = CodeBlock { "ADSK-RED"; false; }
color_palette = ColorPalette({R: 178, G: 34, B: 34, A: 255})
create = Autodesk.AutoCAD.DynamoNodes.Layer.Create(name=code_block_2.out0, document=current, color=color_palette)
exportAsPolylines = Autodesk.Civil.DynamoNodes.CorridorExtensions.TkCorridorFeatureLine.ExportAsPolylines(tkCorridorFeatureLine=code_block, layer=create, matchStyle=code_block_2.out1)
