# Dynamo graph Table Styles.dyn (Dynamo 2.4.1.6394)
# packages: Civil3DToolkit 1.1.10

origin = Point.Origin()
code_block = CodeBlock { ["Title", 0..4, 5..9, []]; }
cell_alignments = CellAlignmentDropDown("Middle Center")
byPointData = Autodesk.AutoCAD.DynamoNodes.Table.ByPointData(point=origin, data=code_block, cellAlignment=cell_alignments)
code_block_2 = CodeBlock { 0; }
color_palette = ColorPalette({R: 143, G: 188, B: 143, A: 255})
setBackgroundColorByRowColumn = Autodesk.AutoCAD.DynamoNodes.Table.SetBackgroundColorByRowColumn(table=byPointData, row=code_block_2, column=code_block_2, color=color_palette)
color_palette_2 = ColorPalette({R: 0, G: 139, B: 139, A: 255})
setContentColorByRowColumn = Autodesk.AutoCAD.DynamoNodes.Table.SetContentColorByRowColumn(table=setBackgroundColorByRowColumn, row=code_block_2, column=code_block_2, color=color_palette_2)
code_block_3 = CodeBlock { "ADSK Consulting"; }
setValueByRowColumn = Autodesk.AutoCAD.DynamoNodes.Table.SetValueByRowColumn(table=setContentColorByRowColumn, row=code_block_2, column=code_block_2, value=code_block_3)
code_block_4 = CodeBlock { 1; 4; }
cell_borders = CellBorderDropDown("All")
line_weights = LineWeightDropDown("0.40")
grid_line_styles = GridLineStyleDropDown("Single")
line_types = LineTypesDropDown("ByBlock")
setBorderByRowColumn = Autodesk.AutoCAD.DynamoNodes.Table.SetBorderByRowColumn(table=setValueByRowColumn, row=code_block_4.out0, column=code_block_4.out1, border=cell_borders, lineWeight=line_weights, lineStyle=grid_line_styles, linetype=line_types)
code_block_5 = CodeBlock { 2; 0.5; }
addColumns = Autodesk.AutoCAD.DynamoNodes.Table.AddColumns(table=setBorderByRowColumn, column=code_block_5.out0, width=code_block_5.out1, amount=code_block_5.out0)
addRows = Autodesk.AutoCAD.DynamoNodes.Table.AddRows(table=addColumns, row=code_block_5.out0, height=code_block_5.out1, amount=code_block_5.out0)
data = Autodesk.AutoCAD.DynamoNodes.Table.Data(table=addRows)
type = Object.Type(obj=data)
height = Autodesk.AutoCAD.DynamoNodes.Table.Height(table=byPointData)
position = Autodesk.AutoCAD.DynamoNodes.Table.Position(table=byPointData)
style = Autodesk.AutoCAD.DynamoNodes.Table.Style(table=addRows)
columns = Autodesk.AutoCAD.DynamoNodes.Table.Columns(table=addRows)
breakEnabled = Autodesk.AutoCAD.DynamoNodes.Table.BreakEnabled(table=addRows)
rows = Autodesk.AutoCAD.DynamoNodes.Table.Rows(table=addRows)
