# Dynamo graph Create Random TIN Surface.dyn (Dynamo 2.4.1.6394)

# group: Inputs
current = Autodesk.AutoCAD.DynamoNodes.Document.Current()
points = IntegerSlider(400, range=3..1000 step 1)  # graph input
min_x = DoubleInput(0)  # graph input
max_x = DoubleInput(1000)  # graph input
min_y = DoubleInput(0)  # graph input
max_y = DoubleInput(1000)  # graph input
min_z = DoubleInput(10)  # graph input
max_z = DoubleInput(15)  # graph input
point_layer = StringInput("_PNT")  # graph input
group_name = StringInput("G1")  # graph input
surface_name = StringInput("S1")  # graph input
surface_layer = StringInput("_SRF")  # graph input

# group: Create Random Points
randomList = Math.RandomList(amount=points)
remapRange = Math.RemapRange(numbers=randomList, newMin=min_x, newMax=max_x)
randomList_2 = Math.RandomList(amount=points)
remapRange_2 = Math.RemapRange(numbers=randomList_2, newMin=min_y, newMax=max_y)
randomList_3 = Math.RandomList(amount=points)
remapRange_3 = Math.RemapRange(numbers=randomList_3, newMin=min_z, newMax=max_z)
byCoordinates = Point.ByCoordinates(x=remapRange, y=remapRange_2, z=remapRange_3)

# group: Create Tin Surface
python_script = Python(IN[0]=byCoordinates, IN[1]=point_layer, IN[2]=group_name, IN[3]=surface_name, IN[4]=surface_layer)
# ---------- python_script.python (40 lines) ----------
"""
Copyright 2020 Autodesk, Inc. All rights reserved.

This file is part of the Civil 3D Python Module.

"""
__author__ = 'Paolo Emilio Serra - paolo.serra@autodesk.com'
__copyright__ = '2020'
__version__ = '1.0.0'

import clr

clr.AddReference('AutoCADNodes')
clr.AddReference('Civil3DNodes')

# Add standard Python references
import sys
sys.path.append('C:\Program Files (x86)\IronPython 2.7\Lib')
import os
import math

import logging
import tempfile

FORMAT = '[%(asctime)-15s] %(levelname)s: %(module)s.%(funcName)s %(message)s'
logging.basicConfig(filename=os.path.join(tempfile.gettempdir(), 'D4C3D.log'), level=logging.DEBUG,
                    format=FORMAT, datefmt='%Y/%m/%d %I:%M:%S')


# Import AutoCAD and Civil 3D Dynamo Nodes
import Autodesk.AutoCAD.DynamoNodes as DA
import Autodesk.Civil.DynamoNodes as DC


doc = DA.Document.Current	
cps = [DC.CogoPoint.ByGeometry(p, IN[1], doc, '', '') for p in IN[0]]
gr = DC.CogoPointGroup.ByCogoPoints(cps, IN[2], doc, '')
surf = DC.TinSurface.ByCogoPointGroup(IN[2], IN[3], IN[4], doc)

OUT = surf
# ----------------------------------------
