# Dynamo graph Create Solids.dyn (Dynamo 2.4.1.6394)
# packages: Civil3DToolkit 1.1.7

current = Autodesk.AutoCAD.DynamoNodes.Document.Current()
surfaces = Surfaces(document=current)
code_block = CodeBlock { 1; "0"; }
createSolids = Autodesk.Civil.DynamoNodes.TinSurfaceExtensions.CreateSolids(surface=surfaces, depth=code_block.out0)  # unwired: layer
file_path = Filename(".\TinSurfaceSolids.dwg")
createSolidsAtFixedElevation = Autodesk.Civil.DynamoNodes.TinSurfaceExtensions.CreateSolidsAtFixedElevation(surface=surfaces, layer=code_block.out1)  # unwired: elevation
code_block_2 = CodeBlock { 300; }
code_block_3 = CodeBlock(a=surfaces) { a[0]; a[1]; }
createSolidsAtSurface = Autodesk.Civil.DynamoNodes.TinSurfaceExtensions.CreateSolidsAtSurface(surface=code_block_3.out0, bottomSurface=code_block_3.out1, layer=code_block.out1)  # unwired: path
byName = Autodesk.Civil.DynamoNodes.LandDevelopment.FeatureLine.ByName(document=current)  # unwired: featurelineName
polyCurve = Autodesk.Civil.DynamoNodes.LandDevelopment.FeatureLine.PolyCurve()  # unwired: featureLine
code_block_4 = CodeBlock { "Feature 1"; }
select_object = ObjectSelection()  # 1 picked in the model
geometry = Autodesk.AutoCAD.DynamoNodes.Object.Geometry(object=select_object)
byPolyCurve = Autodesk.Civil.DynamoNodes.LandDevelopment.FeatureLine.ByPolyCurve(name=code_block_4, curve=geometry)
select_object_2 = ObjectSelection()  # 1 picked in the model
geometry_2 = Autodesk.AutoCAD.DynamoNodes.Object.Geometry(object=select_object_2)
code_block_5 = CodeBlock { "F2"; }
code_block_6 = CodeBlock { true; }
setElevationFromSurface = Autodesk.Civil.DynamoNodes.LandDevelopment.FeatureLine.SetElevationFromSurface(surface=code_block_3.out0, includeIntermediate=code_block_6)  # unwired: featureLine
polyCurve_2 = Autodesk.Civil.DynamoNodes.LandDevelopment.FeatureLine.PolyCurve(featureLine=setElevationFromSurface)
getAllPoints = Autodesk.Civil.DynamoNodes.LandDevelopment.FeatureLine.GetAllPoints(featureLine=setElevationFromSurface)
code_block_7 = CodeBlock { "0"; }
modelSpace = Autodesk.AutoCAD.DynamoNodes.Document.ModelSpace(document=current)
byPoints = Autodesk.AutoCAD.DynamoNodes.Polyline3D.ByPoints(points=getAllPoints, layer=code_block_7, block=modelSpace)
geometry_3 = Autodesk.AutoCAD.DynamoNodes.Object.Geometry(object=byPoints)
